# Grasshopper definition -template_demo.gh (Grasshopper 0.9.76)
# plug-ins: Python Interpreter

# ---- group: get inputs from job results
python = PythonScript(jobName="_job name_", id="0")  # -> inputs
# ---------- python: Python ----------
path = ghenv.Component.OnPingDocument().FilePath
path = path.split("\\")
path = "\\".join(path[:-1] + [jobName, "results.tsv"])

with open(path, 'r') as f:
    data = f.readlines()

headers = data.pop(0).split('\t')

designs = {}
for d in data:
    line = d.split('\t')
    designs[ int(line[headers.index('id')]) ] = [x for i,x in enumerate(line) if "[in" in headers[i]]

inputs = designs[int(id)]
# ---------- end python ----------

# ---- group: get inputs from file
python_2 = PythonScript()  # -> path
# ---------- python_2: Python ----------
path = ghenv.Component.OnPingDocument().FilePath
path = path.split("\\")
path = "\\".join(path[:-1] + ["inputs.txt"])
# ---------- end python_2 ----------
file = ReadFile(File=python_2, PerLineParse=True)

# ----
bang = ExplodeTree(Inputs=simplify(graft(file)))  # -> Branch0, Branch1, Branch2
data_in = Panel(file)

# ---- group: unpack series
python_3 = PythonScript(x=bang.Branch0)  # -> a
# ---------- python_3: Python ----------
import json
a = json.loads(x)
# ---------- end python_3 ----------

# ----
pt = ConstructPoint(XCoordinate=0, YCoordinate=0, ZCoordinate=0)
pt_2 = ConstructPoint(XCoordinate=bang.Branch0, YCoordinate=bang.Branch1, ZCoordinate=bang.Branch2)
box = Box2Pt(PointA=pt, PointB=pt_2, Plane=PlaneXY(0, 0, 0))
geo = Geometry(box)
area = Area(Geometry=geo)  # -> Area, Centroid
volume = Volume(Geometry=geo)  # -> Volume, Centroid
merge = Merge(Data1=flatten(area.Area), Data2=flatten(volume.Volume))

# ---- group: screenshot
python_4 = PythonScript()  # -> path
# ---------- python_4: Python ----------
path = ghenv.Component.OnPingDocument().FilePath
path = path.split("\\")
path = "\\".join(path[:-1] + ["gh.ping"])
# ---------- end python_4 ----------
file_2 = ReadFile(File=python_4, PerLineParse=True)
python_5 = PythonScript(id=file_2)  # -> out
# ---------- python_5: Python ----------
import pickle
import rhinoscriptsyntax as rs

localFolder = "\\".join(ghenv.Component.OnPingDocument().FilePath.split("\\")[:-1]) + "\\"

with open(localFolder + "meta.file", 'rb') as f:
    meta = pickle.load(f)

jobID = meta['jobID']
#    designID = meta['designID']

imageFolder = localFolder + str(jobID) + "\\images\\"
imageName = imageFolder + str(id) + ".png"
rs.Command("_-ViewCaptureToFile \n\"" + imageName + "\"\n _Enter")

outputFile = localFolder + "python.ping"
with open(outputFile, 'w') as f:
    f.write('ack')

print "complete"
# ---------- end python_5 ----------

# ----
data_out = Panel(merge)

# ---- group: write to output file
python_6 = PythonScript(data=merge)  # -> out; inputs data: list
# ---------- python_6: Python ----------
import pickle
import rhinoscriptsyntax as rs

localFolder = "\\".join(ghenv.Component.OnPingDocument().FilePath.split("\\")[:-1]) + "\\"

outputFile = localFolder + "outputs.txt"
with open(outputFile, 'w') as f:
    f.write('\n'.join([str(x) for x in data]))

print "complete"
# ---------- end python_6 ----------
