# Grasshopper definition branching.gh (Grasshopper 0.9.76)
# plug-ins: Python Interpreter

# ---- group: get inputs from job results
python = PythonScript(jobName="_branching_constrained_170327_010131", id="11")  # -> out, inputs
# ---------- python: Python ----------
path = ghenv.Component.OnPingDocument().FilePath
path = path.split("\\")
path = "\\".join(path[:-1] + [jobName, "results.tsv"])

with open(path, 'r') as f:
    data = f.readlines()

headers = data.pop(0).split('\t')

designs = {}
for d in data:
    line = d.split('\t')
    designs[ int(line[headers.index('id')]) ] = [x for i,x in enumerate(line) if "[in" in headers[i] or "[ser" in headers[i]]

inputs = designs[int(id)]
# ---------- end python ----------

# ---- group: get inputs from file
python_2 = PythonScript()  # -> out, path
# ---------- python_2: Python ----------
path = ghenv.Component.OnPingDocument().FilePath
path = path.split("\\")
path = "\\".join(path[:-1] + ["inputs.txt"])
# ---------- end python_2 ----------
file = ReadFile(File=python_2.path, PerLineParse=True)

# ----
data_in = Panel(file)
bang = ExplodeTree(Data=simplify(graft(file)))

# ---- group: unpack series
python_3 = PythonScript(x=bang)  # -> out, a
# ---------- python_3: Python ----------
import json

a = json.loads(x)
# ---------- end python_3 ----------

# ----
genes = GenePool(
    Decimals=2,
    Maximum=3,
    Minimum=0,
    Value=[1.350602907, 1.123493047, 0.04710123457, 0.3262421732, 2.211422285, 1.267025552, 0.168558817, 2.235396326, 0.09350185799, 2.759943556])
int = Integer(python_3.a)
pt = ConstructPoint(XCoordinate=0, YCoordinate=0, ZCoordinate=0)
round = Round(Number=int)  # -> Nearest, Floor, Ceiling
python_4 = PythonScript(start=pt, params=round.Floor)  # -> out, lines; inputs params: list
# ---------- python_4: Python ----------
import rhinoscriptsyntax as rs

lines = []
stack = []

spread = .5
height = .5

iter = len(params)

def grow(dir):
    if len(params) <= 0:
        return None
    
    point = stack.pop(0)
    if point.Z > 3:
        return None
    
    param = params.pop()

    if param == 2:
        for m in [-1,1]:
            p = rs.AddPoint(point.X + m * spread * dir[0], point.Y + m * spread * dir[1], point.Z + height)
            stack.append(rs.coerce3dpoint(p))
            lines.append(rs.AddLine(point, p))
            grow(list(reversed(dir)))
    elif param == 1:
        p1 = rs.AddPoint(point.X, point.Y, point.Z+1)
        stack.append(rs.coerce3dpoint(p1))
        lines.append(rs.AddLine(point, p1))
        grow(dir)

stack.append(rs.coerce3dpoint(start))

grow([0,1])
# ---------- end python_4 ----------
end = EndPoints(Curve=python_4.lines)  # -> Start, End
merge = Merge(Data1=flatten(pt), Data2=flatten(end.Start), Data3=flatten(end.End))
cullpt = CullDuplicates(Points=merge, Tolerance=0.1, CullMode=3)  # -> Points, Indices, Valence
pt_2 = ConstructPoint(XCoordinate=0, YCoordinate=0, ZCoordinate=Slider(3, range=0..10))
pdecon = Deconstruct(Point=cullpt.Points)  # -> XComponent, YComponent, ZComponent
sph = Sphere(Base=pt_2, Radius=Slider(0.9, range=0..1))
bnd = Bounds(Numbers=pdecon.XComponent)
bnd_2 = Bounds(Numbers=pdecon.YComponent)
bnd_3 = Bounds(Numbers=pdecon.ZComponent)
brepinc = PointInBrep(Brep=sph, Point=cullpt.Points, Strict=False)
dedomain = DeconstructDomain(Domain=bnd)  # -> Start, End
dedomain_2 = DeconstructDomain(Domain=bnd_2)  # -> Start, End
dedomain_3 = DeconstructDomain(Domain=bnd_3)  # -> Start, End
ma = MassAddition(Input=brepinc)  # -> Result, PartialResults
subtraction = Subtraction(A=dedomain.Start, B=dedomain.End)
subtraction_2 = Subtraction(A=dedomain_2.Start, B=dedomain_2.End)
subtraction_3 = Subtraction(A=dedomain_3.Start, B=dedomain_3.End)
abs = Absolute(Value=subtraction)
abs_2 = Absolute(Value=subtraction_2)
abs_3 = Absolute(Value=subtraction_3)
merge_2 = Merge(Data1=flatten(abs), Data2=flatten(abs_2), Data3=flatten(abs_3), Data4=flatten(ma.Result))

# ---- group: screenshot
python_5 = PythonScript()  # -> out, path
# ---------- python_5: Python ----------
path = ghenv.Component.OnPingDocument().FilePath
path = path.split("\\")
path = "\\".join(path[:-1] + ["gh.ping"])
# ---------- end python_5 ----------
file_2 = ReadFile(File=python_5.path, PerLineParse=True)
python_6 = PythonScript(id=file_2)  # -> out
# ---------- python_6: Python ----------
import pickle
import rhinoscriptsyntax as rs

localFolder = "\\".join(ghenv.Component.OnPingDocument().FilePath.split("\\")[:-1]) + "\\"

with open(localFolder + "meta.file", 'rb') as f:
    meta = pickle.load(f)

jobID = meta['jobID']
#    designID = meta['designID']

imageFolder = localFolder + str(jobID) + "\\images\\"
imageName = imageFolder + str(id) + ".png"
rs.Command("_-ViewCaptureToFile \n\"" + imageName + "\"\n _Enter")

outputFile = localFolder + "python.ping"
with open(outputFile, 'w') as f:
    f.write('ack')

print "complete"
# ---------- end python_6 ----------

# ----
data_out = Panel(merge_2)

# ---- group: write to output file
python_7 = PythonScript(data=merge_2)  # -> out; inputs data: list
# ---------- python_7: Python ----------
import pickle
import rhinoscriptsyntax as rs

localFolder = "\\".join(ghenv.Component.OnPingDocument().FilePath.split("\\")[:-1]) + "\\"

outputFile = localFolder + "outputs.txt"
with open(outputFile, 'w') as f:
    f.write('\n'.join([str(x) for x in data]))

print "complete"
# ---------- end python_7 ----------
