# Grasshopper definition chair.gh (Grasshopper 0.9.76)
# plug-ins: Karamba, Python Interpreter

# ---- group: get inputs from job results
python = PythonScript(jobName="_job name_", id="0")  # -> out, inputs
# ---------- python: Python ----------
path = ghenv.Component.OnPingDocument().FilePath
path = path.split("\\")
path = "\\".join(path[:-1] + [jobName, "results.tsv"])

with open(path, 'r') as f:
    data = f.readlines()

headers = data.pop(0).split('\t')

designs = {}
for d in data:
    line = d.split('\t')
    designs[ int(line[headers.index('id')]) ] = [x for i,x in enumerate(line) if "[in" in headers[i] or "[ser" in headers[i]]

inputs = designs[int(id)]
# ---------- end python ----------

# ---- group: get inputs from file
python_2 = PythonScript()  # -> out, path
# ---------- python_2: Python ----------
path = ghenv.Component.OnPingDocument().FilePath
path = path.split("\\")
path = "\\".join(path[:-1] + ["inputs.txt"])
# ---------- end python_2 ----------
file = ReadFile(File=python_2.path, PerLineParse=True)

# ----
data_in = Panel(file)
split = SplitList(List=file, Index=Slider(1, range=0..10))  # -> ListA, ListB
split_2 = SplitList(List=split.ListB, Index=Slider(4, range=0..10))  # -> ListA, ListB
split_3 = SplitList(List=split_2.ListB, Index=Slider(1, range=0..10))  # -> ListA, ListB
split_4 = SplitList(List=split_3.ListB, Index=Slider(4, range=0..10))  # -> ListA, ListB
split_5 = SplitList(List=split_4.ListB, Index=Slider(1, range=0..10))  # -> ListA, ListB

# ---- group: unpack series
python_3 = PythonScript(x=split.ListA)  # -> out, a
# ---------- python_3: Python ----------
import json

a = json.loads(x)
# ---------- end python_3 ----------

python_4 = PythonScript(x=split_5.ListA)  # -> out, a; same code as python_3

python_5 = PythonScript(x=split_3.ListA)  # -> out, a; same code as python_3

# ----
pipeline = GeometryPipeline(
    GroupByLayer=False,
    GroupByType=False,
    IncludeHidden=True,
    IncludeLocked=True,
    LayerFilter="load point",
    NameFilter="*",
    TypeFilter=1)
pipeline_2 = GeometryPipeline(
    GroupByLayer=False,
    GroupByType=False,
    IncludeHidden=True,
    IncludeLocked=True,
    LayerFilter="shell",
    NameFilter="*",
    TypeFilter=32)
pipeline_3 = GeometryPipeline(
    GroupByLayer=False,
    GroupByType=False,
    IncludeHidden=True,
    IncludeLocked=True,
    LayerFilter="connection points",
    NameFilter="*",
    TypeFilter=1)
pipeline_4 = GeometryPipeline(
    GroupByLayer=False,
    GroupByType=False,
    IncludeHidden=True,
    IncludeLocked=True,
    LayerFilter="floor points",
    NameFilter="*",
    TypeFilter=1)
demesh = DeconstructMesh(Mesh=pipeline_2)  # -> Vertices, Faces, Colours, Normals
item = ListItem(List=pipeline_3, Index=python_3.a, Wrap=True)
cps = ClosestPoints(Point=pipeline, Cloud=demesh.Vertices, Count=Slider(20, range=0..100))  # -> ClosestPoint, CPIndex, Distance
ln = Line(StartPoint=item, EndPoint=pipeline_4)
eval = EvaluateCurve(Curve=reparameterize(ln), Parameter=split_2.ListA)  # -> Point, Tangent, Angle
X = UnitX(Factor=Slider(0.01, range=0..0.01))
Z = UnitZ(Factor=Slider(1, range=0..1))
merge = Merge(Data1=flatten(pipeline_3), Data2=flatten(eval.Point))
rev = Reverse(Vector=X)
rev_2 = Reverse(Vector=Z)
item_2 = ListItem(List=merge, Index=python_5.a, Wrap=True)
supp = SupportKaramba(PosInd=pipeline_4, menu=[buttons(on, off, on, off, off, off)])
cross_sections = CrossSectionsKaramba(ElementsIdentifiers="shell", Heights_cm=Slider(1, range=0..1), mode="Shell")
meshtoshell = MeshToShellKaramba(Mesh=pipeline_2, LDist=0.005, Identifier="shell")  # -> Point, Element, Info
loads = LoadsKaramba(ForceVector=rev, Local=False, PosInd=cps.ClosestPoint, LCase=0, mode="Point")
loads_2 = LoadsKaramba(Vector=rev_2, LCase=0, mode="Gravity")
cross_sections_2 = CrossSectionsKaramba(
    ElementsIdentifiers="structure",
    Diameter_cm=Slider(1.25, range=0..10),
    WallThickness_cm=Slider(0.2, range=0..1),
    mode="Circular Hollow")
ln_2 = Line(StartPoint=eval.Point, EndPoint=item_2)
eval_2 = EvaluateCurve(Curve=reparameterize(ln_2), Parameter=split_4.ListA)  # -> Point, Tangent, Angle
merge_2 = Merge(Data1=loads_2, Data2=loads)  # -> flatten(Result)
item_3 = ListItem(List=pipeline_3, Index=python_4.a, Wrap=True)
merge_3 = Merge(Data1=cross_sections, Data2=cross_sections_2)
range = Range(Domain=Domain(0, 1), Steps=10)
gradient = Gradient(
    LowerLimit=0,
    UpperLimit=1,
    Parameter=range,
    stops=[0: RGB(234, 38, 0), 0.25: RGB(234, 126, 0), 0.5: RGB(254, 244, 84), 0.75: RGB(173, 203, 249), 1: RGB(75, 107, 169)])
ln_3 = Line(StartPoint=eval.Point, EndPoint=eval_2.Point)
ln_4 = Line(StartPoint=item_2, EndPoint=eval_2.Point)
ln_5 = Line(StartPoint=eval_2.Point, EndPoint=item_3)
ln_6 = Line(StartPoint=eval.Point, EndPoint=pipeline_4)
merge_4 = Merge(Data1=ln_3, Data2=ln_4, Data3=ln_5, Data4=ln_6)  # -> flatten(Result)
rdlines = RemoveDuplicateLinesKaramba(Line=merge_4, LimitDistance=0.005)  # -> OutLine, Info, Indexes
linetobeam = LineToBeamKaramba(Line=rdlines.OutLine, New=True, Remove=True, LimitDistance_m=0.005, BeamIdentifier="structure")  # -> Points, Element, Info
merge_5 = Merge(Data1=meshtoshell.Element, Data2=linetobeam.Element)  # -> flatten(Result)
assemble = AssembleModelKaramba(Elem=merge_5, Support=supp, Load=merge_2, CrossSection=merge_3, LimitDistance_m=0.005)  # -> Model, Info, Mass_kg, CenterOfGravity
analyzethi = AnalyzeThIKaramba(Model=assemble.Model)  # -> CalculatedModel, MaximumDisplacement_m, ResultingForceOfGravity_kN, ElasticEnergy_kNm
modelview = ModelViewKaramba(
    Model=analyzethi.CalculatedModel,
    LoadCaseFactorsForLinearSuperposition=1,
    IndexIncrementOfVisibleLoadcase=0,
    ListOfColorsForColoringPlots=gradient)  # -> Model, DeformedMesh, DeformedAxes, DeformedModel
shellview = ShellViewKaramba(Model=modelview.Model)  # -> Model, MeshesOfRenderedShells, LegendColors, LegendTags
beamview = BeamViewKaramba(Model=shellview.Model)  # -> Model, MeshesOfRenderedBeams, DeformedBeamAxes, LegendColors, LegendTags
displacement_min = Panel(analyzethi.MaximumDisplacement_m)
material_min = Panel(assemble.Mass_kg)
b_res_force = BeamResultantForcesKaramba(AnalyzedModel=beamview.Model, LoadCase=-1, MaximumProbingDistance_m=-1, NumberOfProbingPointsPerElement=3)  # -> AnalyzedModel, NormalForce_kN, ResultantBendingMoment_kNm, ResultantShearForce_kN
abs = Absolute(Value=b_res_force.NormalForce_kN)
bnd = Bounds(Numbers=abs)
merge_6 = Merge(Data1=flatten(displacement_min), Data2=flatten(material_min))

# ---- group: screenshot
python_6 = PythonScript()  # -> out, path
# ---------- python_6: Python ----------
path = ghenv.Component.OnPingDocument().FilePath
path = path.split("\\")
path = "\\".join(path[:-1] + ["gh.ping"])
# ---------- end python_6 ----------
file_2 = ReadFile(File=python_6.path, PerLineParse=True)
python_7 = PythonScript(id=file_2)  # -> out
# ---------- python_7: Python ----------
import pickle
import rhinoscriptsyntax as rs

localFolder = "\\".join(ghenv.Component.OnPingDocument().FilePath.split("\\")[:-1]) + "\\"

with open(localFolder + "meta.file", 'rb') as f:
    meta = pickle.load(f)

jobID = meta['jobID']
#    designID = meta['designID']

imageFolder = localFolder + str(jobID) + "\\images\\"
imageName = imageFolder + str(id) + ".png"
rs.Command("_-ViewCaptureToFile \n\"" + imageName + "\"\n _Enter")

outputFile = localFolder + "python.ping"
with open(outputFile, 'w') as f:
    f.write('ack')

print "complete"
# ---------- end python_7 ----------

# ----
dedomain = DeconstructDomain(Domain=bnd)  # -> Start, End
data_out = Panel(merge_6)

# ---- group: write to output file
python_8 = PythonScript(data=merge_6)  # -> out; inputs data: list
# ---------- python_8: Python ----------
import pickle
import rhinoscriptsyntax as rs

localFolder = "\\".join(ghenv.Component.OnPingDocument().FilePath.split("\\")[:-1]) + "\\"

outputFile = localFolder + "outputs.txt"
with open(outputFile, 'w') as f:
    f.write('\n'.join([str(x) for x in data]))

print "complete"
# ---------- end python_8 ----------
