# Grasshopper definition chair_constrained.gh (Grasshopper 0.9.76)
# plug-ins: Karamba, Python Interpreter

# ---- group: get inputs from job results
python = PythonScript(jobName="_chair_170118_135408", id="9923")  # -> inputs
# ---------- python: Python ----------
path = ghenv.Component.OnPingDocument().FilePath
path = path.split("\\")
path = "\\".join(path[:-1] + [jobName, "results.tsv"])

with open(path, 'r') as f:
    data = f.readlines()

headers = data.pop(0).split('\t')

print headers
print data[0]

designs = {}
for d in data:
    line = d.split('\t')
    designs[ int(line[headers.index('id')]) ] = [x for i,x in enumerate(line) if "[in" in headers[i] or "[ser" in headers[i] or "[seq" in headers[i]]

inputs = designs[int(id)]
# ---------- end python ----------

# ---- group: get inputs from file
python_2 = PythonScript()  # -> path
# ---------- python_2: Python ----------
path = ghenv.Component.OnPingDocument().FilePath
path = path.split("\\")
path = "\\".join(path[:-1] + ["inputs.txt"])
# ---------- end python_2 ----------
file = ReadFile(File=python_2, PerLineParse=True)

# ----
split = SplitList(List=file, Index=Slider(1, range=0..10))  # -> ListA, ListB
split_2 = SplitList(List=split.ListB, Index=Slider(4, range=0..10))  # -> ListA, ListB
split_3 = SplitList(List=split_2.ListB, Index=Slider(1, range=0..10))  # -> ListA, ListB
split_4 = SplitList(List=split_3.ListB, Index=Slider(4, range=0..10))  # -> ListA, ListB
split_5 = SplitList(List=split_4.ListB, Index=Slider(1, range=0..10))  # -> ListA, ListB
python_3 = PythonScript(x=split.ListA)  # -> a
# ---------- python_3: Python ----------
import json

a = json.loads(x)
# ---------- end python_3 ----------
python_4 = PythonScript(x=split_3.ListA)  # -> a; same code as python_3
python_5 = PythonScript(x=split_5.ListA)  # -> a; same code as python_3
pipeline = GeometryPipeline(
    GroupByLayer=False,
    GroupByType=False,
    IncludeHidden=True,
    IncludeLocked=True,
    LayerFilter="connection points",
    NameFilter="*",
    TypeFilter=1)
pipeline_2 = GeometryPipeline(
    GroupByLayer=False,
    GroupByType=False,
    IncludeHidden=True,
    IncludeLocked=True,
    LayerFilter="shell",
    NameFilter="*",
    TypeFilter=32)
pipeline_3 = GeometryPipeline(
    GroupByLayer=False,
    GroupByType=False,
    IncludeHidden=True,
    IncludeLocked=True,
    LayerFilter="load point",
    NameFilter="*",
    TypeFilter=1)
pipeline_4 = GeometryPipeline(
    GroupByLayer=False,
    GroupByType=False,
    IncludeHidden=True,
    IncludeLocked=True,
    LayerFilter="floor points",
    NameFilter="*",
    TypeFilter=1)
demesh = DeconstructMesh(Mesh=pipeline_2)  # -> Vertices, Faces, Colours, Normals
cps = ClosestPoints(Point=pipeline_3, Cloud=demesh.Vertices, Count=Slider(20, range=0..100))  # -> ClosestPoint, CPIndex, Distance
item = ListItem(List=pipeline, Index=python_3, Wrap=True)
ln = Line(StartPoint=item, EndPoint=pipeline_4)
X = UnitX(Factor=Slider(0.01, range=0..0.01))
Z = UnitZ(Factor=Slider(1, range=0..1))
rev = Reverse(Vector=X)
rev_2 = Reverse(Vector=Z)
eval = EvaluateCurve(Curve=reparameterize(ln), Parameter=split_2.ListA)  # -> Point, Tangent, Angle
supp = SupportKaramba(PosInd=pipeline_4, menu=[buttons(on, off, on, off, off, off)])
cross_sections = CrossSectionsKaramba(ElementsIdentifiers="shell", Heights_cm=Slider(1, range=0..1), mode="Shell")
meshtoshell = MeshToShellKaramba(Mesh=pipeline_2, LDist=0.005, Identifier="shell")  # -> Point, Element, Info
loads = LoadsKaramba(ForceVector=rev, Local=False, PosInd=cps.ClosestPoint, LCase=0, mode="Point")
loads_2 = LoadsKaramba(Vector=rev_2, LCase=0, mode="Gravity")
cross_sections_2 = CrossSectionsKaramba(
    ElementsIdentifiers="structure",
    Diameter_cm=Slider(1.25, range=0..10),
    WallThickness_cm=Slider(0.2, range=0..1),
    mode="Circular Hollow")
merge = Merge(Data1=flatten(pipeline), Data2=flatten(eval.Point))
merge_2 = Merge(Data1=loads_2, Data2=loads)  # -> flatten(Result)
merge_3 = Merge(Data1=cross_sections, Data2=cross_sections_2)
item_2 = ListItem(List=merge, Index=python_4, Wrap=True)
range = Range(Domain=Domain(0, 1), Steps=10)
ln_2 = Line(StartPoint=eval.Point, EndPoint=item_2)
gradient = Gradient(
    LowerLimit=0,
    UpperLimit=1,
    Parameter=range,
    stops=[0: RGB(234, 38, 0), 0.25: RGB(234, 126, 0), 0.5: RGB(254, 244, 84), 0.75: RGB(173, 203, 249), 1: RGB(75, 107, 169)])
ln_3 = Line(StartPoint=eval.Point, EndPoint=pipeline_4)
eval_2 = EvaluateCurve(Curve=reparameterize(ln_2), Parameter=split_4.ListA)  # -> Point, Tangent, Angle
item_3 = ListItem(List=pipeline, Index=python_5, Wrap=True)
ln_4 = Line(StartPoint=eval_2.Point, EndPoint=item_3)
ln_5 = Line(StartPoint=eval.Point, EndPoint=eval_2.Point)
ln_6 = Line(StartPoint=item_2, EndPoint=eval_2.Point)
merge_4 = Merge(Data1=ln_3, Data2=ln_5, Data3=ln_6, Data4=ln_4)  # -> flatten(Result)
rdlines = RemoveDuplicateLinesKaramba(Line=merge_4, LimitDistance=0.005)  # -> OutLine, Info, Indexes
linetobeam = LineToBeamKaramba(Line=rdlines.OutLine, New=True, Remove=True, LimitDistance_m=0.005, BeamIdentifier="structure")  # -> Points, Element, Info
merge_5 = Merge(Data1=meshtoshell.Element, Data2=linetobeam.Element)  # -> flatten(Result)
assemble = AssembleModelKaramba(Elem=merge_5, Support=supp, Load=merge_2, CrossSection=merge_3, LimitDistance_m=0.005)  # -> Model, Info, Mass_kg, CenterOfGravity
analyzethi = AnalyzeThIKaramba(Model=assemble.Model)  # -> CalculatedModel, MaximumDisplacement_m, ResultingForceOfGravity_kN, ElasticEnergy_kNm
modelview = ModelViewKaramba(
    Model=analyzethi.CalculatedModel,
    LoadCaseFactorsForLinearSuperposition=1,
    IndexIncrementOfVisibleLoadcase=0,
    ListOfColorsForColoringPlots=gradient)  # -> Model, DeformedMesh, DeformedAxes, DeformedModel
displacement_min = Panel(analyzethi.MaximumDisplacement_m)
material_min = Panel(assemble.Mass_kg)
join = JoinCurves(Curves=rdlines.OutLine, Preserve=False)
shellview = ShellViewKaramba(Model=modelview.Model)  # -> Model, MeshesOfRenderedShells, LegendColors, LegendTags
simplify = SimplifyCurve(Curve=join)  # -> Curve, Simplified
explode = Explode(Curve=simplify.Curve, Recursive=True)  # -> flatten(Segments), Vertices
beamview = BeamViewKaramba(Model=shellview.Model)  # -> Model, MeshesOfRenderedBeams, DeformedBeamAxes, LegendColors, LegendTags
llinter = LineLineIntersectionKaramba(Line=explode.Segments, LengthTolerance=0.01)  # -> IntersectionPoints, flatten(LineSubSegements)

# ---- group: take screenshot
python_6 = PythonScript()  # -> path
# ---------- python_6: Python ----------
path = ghenv.Component.OnPingDocument().FilePath
path = path.split("\\")
path = "\\".join(path[:-1] + ["gh.ping"])
# ---------- end python_6 ----------
file_2 = ReadFile(File=python_6, PerLineParse=True)
python_7 = PythonScript(id=file_2)  # -> out
# ---------- python_7: Python ----------
import pickle
import rhinoscriptsyntax as rs

localFolder = "\\".join(ghenv.Component.OnPingDocument().FilePath.split("\\")[:-1]) + "\\"

with open(localFolder + "meta.file", 'rb') as f:
    meta = pickle.load(f)

jobID = meta['jobID']
#    designID = meta['designID']

imageFolder = localFolder + str(jobID) + "\\images\\"
imageName = imageFolder + str(id) + ".png"
rs.Command("_-ViewCaptureToFile \n\"" + imageName + "\"\n _Enter")

outputFile = localFolder + "python.ping"
with open(outputFile, 'w') as f:
    f.write('ack')

print "complete"
# ---------- end python_7 ----------

# ----
b_res_force = BeamResultantForcesKaramba(AnalyzedModel=beamview.Model, LoadCase=-1, MaximumProbingDistance_m=-1, NumberOfProbingPointsPerElement=3)  # -> AnalyzedModel, NormalForce_kN, ResultantBendingMoment_kNm, ResultantShearForce_kN
demesh_2 = DeconstructMesh(Mesh=beamview.MeshesOfRenderedBeams)  # -> Vertices, Faces, Colours, Normals
abs = Absolute(Value=b_res_force.NormalForce_kN)
len = Length(Curve=llinter.LineSubSegements)
conmesh = ConstructMesh(Vertices=demesh_2.Vertices, Faces=demesh_2.Faces, Colours=ColourSwatch(SwatchColor=RGB(130, 130, 130)))
python_8 = PythonScript(lines=llinter.LineSubSegements)  # -> out, nodes, connectivity; inputs lines: list
# ---------- python_8: Python ----------
import rhinoscriptsyntax as rs
from math import sqrt
import json

def pointDistance(pt1, pt2):
    return sqrt( (pt2[0] - pt1[0])**2 + (pt2[1] - pt1[1])**2 + (pt2[2] - pt1[2])**2 )


e = 0.001


nodes = []
graph = {}

#build graph
for l in lines:
    pt1 = rs.CurveStartPoint(l)
    pt2 = rs.CurveEndPoint(l)
    
    case = [-1] * 2
    
    for j, pt in enumerate([pt1, pt2]):
        for i, node in enumerate(nodes):
            if pointDistance( pt, node ) < e:
                case[j] = i
                break
    
    #make nodes and graph dict entries as necessary
    if case[0] == -1:
        case[0] = len(nodes)
        nodes.append(pt1)
        graph[case[0]] = []
    if case[1] == -1:
        case[1] = len(nodes)
        nodes.append(pt2)
        graph[case[1]] = []
    
    #create new connections
    graph[case[0]].append([case[1], rs.CurveLength(l)])
    graph[case[1]].append([case[0], rs.CurveLength(l)])

connectivity = [len(graph[node]) for node in graph.keys()]
# ---------- end python_8 ----------
bnd = Bounds(Numbers=abs)
larger = LargerThan(FirstNumber=len, SecondNumber=Slider(0.3, range=0..1))  # -> LargerThan, OrEqualTo
dedomain = DeconstructDomain(Domain=bnd)  # -> Start, End
equals = Equality(FirstNumber=python_8.connectivity, SecondNumber=Slider(2, range=0..10))  # -> Equality, Inequality
cull = CullPattern(List=llinter.LineSubSegements, CullPattern=larger.LargerThan)
ma = MassAddition(Input=equals.Equality)  # -> Result, PartialResults
number_of_kinks = Panel(ma.Result)
ma_2 = MassAddition(Input=larger.LargerThan)  # -> Result, PartialResults
pieces_longer_than_0_3m = Panel(ma_2.Result)

# ---- group: write to output file
merge_6 = Merge(
    Data1=flatten(displacement_min),
    Data2=flatten(material_min),
    Data3=flatten(pieces_longer_than_0_3m),
    Data4=flatten(number_of_kinks))
python_9 = PythonScript(data=merge_6)  # -> out; inputs data: list
# ---------- python_9: Python ----------
import pickle
import rhinoscriptsyntax as rs

localFolder = "\\".join(ghenv.Component.OnPingDocument().FilePath.split("\\")[:-1]) + "\\"
print localFolder

outputFile = localFolder + "outputs.txt"
with open(outputFile, 'w') as f:
    f.write('\n'.join([str(x) for x in data]))

print "complete"
# ---------- end python_9 ----------
