# Grasshopper definition pill.gh (Grasshopper 0.9.76)
# plug-ins: Python Interpreter

# ---- group: get inputs from job results
python = PythonScript(jobName="_job name_", id="0")  # -> out, inputs
# ---------- python: Python ----------
path = ghenv.Component.OnPingDocument().FilePath
path = path.split("\\")
path = "\\".join(path[:-1] + [jobName, "results.tsv"])

with open(path, 'r') as f:
    data = f.readlines()

headers = data.pop(0).split('\t')

designs = {}
for d in data:
    line = d.split('\t')
    designs[ int(line[headers.index('id')]) ] = [x for i,x in enumerate(line) if "[in" in headers[i]]

inputs = designs[int(id)]
# ---------- end python ----------

# ---- group: get inputs from file
python_2 = PythonScript()  # -> out, path
# ---------- python_2: Python ----------
path = ghenv.Component.OnPingDocument().FilePath
path = path.split("\\")
path = "\\".join(path[:-1] + ["inputs.txt"])
# ---------- end python_2 ----------
file = ReadFile(File=python_2.path, PerLineParse=True)

# ----
data_in = Panel(file)
bang = ExplodeTree(Data=simplify(graft(file)))  # -> Branch0, Branch1, Branch2
geo = Geometry(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)
cp = ControlPoints(Curve=geo)  # -> Points, Weights, Knots
X = UnitX(Factor=bang.Branch0)
X_2 = UnitX(Factor=bang.Branch1)
X_3 = UnitX(Factor=bang.Branch2)
end = EndPoints(Curve=geo)  # -> Start, End
split = SplitList(List=cp.Points, Index=Slider(1, range=0..1))  # -> ListA, ListB
split_2 = SplitList(List=split.ListB, Index=Slider(3, range=0..10))  # -> ListA, ListB
move = Move(Geometry=split.ListA, Motion=X)  # -> Geometry, Transform
move_2 = Move(Geometry=split_2.ListA, Motion=X_2)  # -> Geometry, Transform
move_3 = Move(Geometry=split_2.ListB, Motion=X_3)  # -> Geometry, Transform
merge = Merge(Data1=flatten(move.Geometry), Data2=flatten(move_2.Geometry), Data3=flatten(move_3.Geometry))
end_2 = EndPoints(Curve=geo)  # -> Start, End
nurbcrv = NurbsCurve(Points=merge, Weights=cp.Weights, Knots=cp.Knots)  # -> Curve, Length, Domain
ln = Line(StartPoint=end_2.Start, EndPoint=end_2.End)
revsrf = Revolution(Curve=nurbcrv.Curve, Axis=ln, Domain=Domain(0, 6.283185307))
cap = CapHoles(Brep=revsrf)
volume = Volume(Geometry=cap)  # -> Volume, Centroid
area = Area(Geometry=cap)  # -> Area, Centroid
merge_2 = Merge(Data1=flatten(area.Area), Data2=flatten(volume.Volume))

# ---- group: screenshot
python_3 = PythonScript()  # -> out, path
# ---------- python_3: Python ----------
path = ghenv.Component.OnPingDocument().FilePath
path = path.split("\\")
path = "\\".join(path[:-1] + ["gh.ping"])
# ---------- end python_3 ----------
file_2 = ReadFile(File=python_3.path, PerLineParse=True)
python_4 = PythonScript(id=file_2)  # -> out
# ---------- python_4: Python ----------
import pickle
import rhinoscriptsyntax as rs

localFolder = "\\".join(ghenv.Component.OnPingDocument().FilePath.split("\\")[:-1]) + "\\"

with open(localFolder + "meta.file", 'rb') as f:
    meta = pickle.load(f)

jobID = meta['jobID']
#    designID = meta['designID']

imageFolder = localFolder + str(jobID) + "\\images\\"
imageName = imageFolder + str(id) + ".png"
rs.Command("_-ViewCaptureToFile \n\"" + imageName + "\"\n _Enter")

outputFile = localFolder + "python.ping"
with open(outputFile, 'w') as f:
    f.write('ack')

print "complete"
# ---------- end python_4 ----------

# ----
data_out = Panel(merge_2)

# ---- group: write to output file
python_5 = PythonScript(data=merge_2)  # -> out; inputs data: list
# ---------- python_5: Python ----------
import pickle
import rhinoscriptsyntax as rs

localFolder = "\\".join(ghenv.Component.OnPingDocument().FilePath.split("\\")[:-1]) + "\\"

outputFile = localFolder + "outputs.txt"
with open(outputFile, 'w') as f:
    f.write('\n'.join([str(x) for x in data]))

print "complete"
# ---------- end python_5 ----------
